# Grasshopper definition image-import-to-rhino.gh (Grasshopper 1.0.8)

panel = Panel("C:/Users/Varun SA/Documents/rhino-sketch-interface/sketches")
boolean_toggle = BooleanToggle(True)
geometry_pipeline = GeometryPipeline(
    GroupByLayer=False,
    GroupByType=False,
    IncludeHidden=True,
    IncludeLocked=True,
    LayerFilter="gen-geo",
    NameFilter="*",
    SublayerFiltering=True,
    TypeFilter=4)
panel_2 = Panel("C:\Users\Varun SA\Documents\rhino-sketch-interface\rhino-lines\rhino-lines.json")
python_3_script = Python3Script(folder=panel, refresh=boolean_toggle)  # -> a
# ---------- python_3_script: Python ----------
import os

# Only run if the button is clicked
if refresh:

    # Check if folder exists
    if not os.path.exists(folder):
        a = "Folder does not exist"

    else:
        # List all numbered PNG files
        pngs = [
            f for f in os.listdir(folder)
            if f.endswith(".png") and f.split(".")[0].isdigit()
        ]

        if not pngs:
            a = "No PNG files found"
        else:
            # Pick the one with the highest number
            highest_file = max(pngs, key=lambda x: int(x.split(".")[0]))

            # Create full path
            image_path = os.path.join(folder, highest_file)

            # Output the latest path
            a = image_path
else:
    # If refresh is not clicked, keep output empty
    a = None
# ---------- end python_3_script ----------
panel_3 = Panel(geometry_pipeline)
import_image = ImportImage(File=python_3_script)
scale = Scale(Geometry=import_image, Center=Point(0, 0, 0), Factor=Slider(2, range=0.1..100))  # -> Geometry, Transform
python_3_script_2 = Python3Script(geo=geometry_pipeline, image_geom=scale.Geometry, path=panel_2, trigger=boolean_toggle)  # -> out, a; inputs geo: list of Curve, image_geom: Mesh, path: String, trigger: Boolean
# ---------- python_3_script_2: Python ----------
import Rhino.Geometry as rg
import json

print(type(geo))
print(len(geo))

# Get bounding box of the Rhino image surface (your reference canvas)
bbox = image_geom.GetBoundingBox(True)
min_pt = bbox.Min
max_pt = bbox.Max

# Dimensions of the bounding box (Rhino canvas)
width = max_pt.X - min_pt.X
height = max_pt.Y - min_pt.Y

points_data = []
curve_pts_coor = []

for crv in geo:
    if isinstance(crv, rg.Curve):
        parameters = crv.DivideByCount(30, True)  # Or 10/20 etc.
        if parameters:
            points = []
            for t in parameters:
                pt = crv.PointAt(t)
                x_norm = (pt.X - min_pt.X) / width
                y_norm = 1 - (pt.Y - min_pt.Y) / height  # Flip Y for canvas
                points.append([x_norm, y_norm])
            points_data.append(points)

print(path)

with open(path, "w") as f:
    json.dump(points_data, f, indent=2)
    print("JSON exported")
# ---------- end python_3_script_2 ----------
panel_4 = Panel(scale.Geometry)
panel_5 = Panel(python_3_script_2.a)
